# Grasshopper definition lightning.gh (Grasshopper 0.9.76)
# plug-ins: Python Interpreter

python_script = PythonScript(
    xsteps=Slider(11, range=1..50),
    radius=Slider(10, range=0..10),
    stride=Slider(4.07, range=0..10),
    seed=Slider(41310, range=0..100000),
    split=".1")  # -> out, points, curve_list, circles
# ---------- python_script: Python ----------
import math
import random

import rhinoscriptsyntax as rs
import Rhino.Geometry as rg


if seed is not None:
	random.seed(seed)

start = rg.Point3d(0,0,0)

points = [start]
curve_list = []
thicknesses = []
circles = []

degrees = 180


def point_from_vector(start, direction, scale):
	x, y = [scale * op(direction) for op in (math.sin, math.cos)]
	return rs.PointAdd(start, rg.Point3d(x, 0, y))
	
	
def split_thickness(t):
	return [t / 2.0, t / 2.0]
	

def scale_vector(v, scale):
	return [scale * e for e in v] 

def get_new_point(p):
	radians = (2 * math.pi) * degrees / 360.0
	direction = random.uniform(-1/2.0 * radians, radians / 2.0)
	np = point_from_vector(p, direction, stride)
	return np
	
def get_circle(p, steps):
	
	step = xsteps - steps
	
	height = step * stride
	
	if step == 0:
		scaled_radius = .01
	else:
		scaled_radius = step * radius
	
	center = rg.Point3d(0,0, height)
	
	
	
	rotation = random.uniform(0, 2 * math.pi)
	
	normal_vector= rs.PointSubtract(rg.Point3d(0,0,1), rg.Point3d(0,0,0))
	normal_plane = rs.PlaneFromNormal(center, normal_vector)
	circle = rs.AddCircle(normal_plane, scaled_radius)
	circles.append(circle) 
	return circle
	
	


def loop(steps, parent, thickness):
	
	if steps == 0:
		return
		
	new_point = get_new_point(parent)
	get_circle(parent, steps)
		
	c = rs.AddCurve([parent, new_point])
	curve_list.append(c)
	thicknesses.append(thickness)
	points.append(new_point)
		
	if random.random() < split:
		t1, t2 = split_thickness(thickness)
		loop(steps - 1, new_point, t1)
		loop(steps - 1, rg.Point3d(new_point), t2)
	else:
		loop(steps - 1, new_point, thickness)
		
loop(xsteps, start, 1.0)
# ---------- end python_script ----------
curve = Curve(python_script.circles)
point = Point(python_script.points)
shift_list = ShiftList(List=curve, Shift=1, Wrap=False)
curve_2 = Curve(python_script.curve_list)
shortest_list = ShortestList(ListA=curve, ListB=shift_list, TrimMode=2)  # -> ListA, ListB
entwine = Entwine(Branch00=graft(shortest_list.ListA), Branch01=graft(shortest_list.ListB), FlattenInputs=True)
flip_matrix = FlipMatrix(Data=entwine)
loft = Loft(Curves=flip_matrix, Options={Adjust=False, Closed=False, LoftEnds=0, LoftSimp=0, LoftType=0, Rebuild=10, Refit=0.01})
panel = Panel(entwine)
